# Grasshopper definition offset.gh (Grasshopper 1.0.7)
# plug-ins: ClipperComponents, GrassPlugin

crv = Curve(<curve referenced from the Rhino model>)
crv_2 = Curve(<curve referenced from the Rhino model>)
crv_3 = Curve(<curve referenced from the Rhino model>)
crv_4 = Curve(<curve referenced from the Rhino model>)
end = EndPoints(Curve=crv_3)  # -> Start, End
crv_5 = Curve(<curve referenced from the Rhino model>)
crv_6 = Curve(<curve referenced from the Rhino model>)
pt = Point(end.End)
number_slider = Slider(54, range=0..100)
cp = ControlPoints(Curve=crv_3)  # -> Points, Weights, Knots
crv_7 = Curve(crv_3)
subtraction = Subtraction(B=5)
points = PointList(Points=cp.Points, Size=Slider(61, range=0..1000))
offset = OffsetCurve(Curve=crv_7, Distance=number_slider, Corners=1)
nickname = GrassPlugin(Curve=crv_7, Offset=Slider(-70, range=-100..0))
polyoffset = PolylineOffset(
    Polylines=crv_7,
    Distance=number_slider,
    Plane=Plane(origin=(0, 0, 0), x=(0, 0, 0), y=(0, 0, 0)),
    Tolerance=Slider(1, range=0..1),
    ClosedFillet=2,
    OpenFillet=1,
    Miter=Slider(5, range=0..10))  # -> Contour, Holes
item = ListItem(List=nickname, Index=0, Wrap=True)  # -> Item, Item1
cls = Closed(Curve=polyoffset.Contour)  # -> Closed, Periodic
cp_2 = ControlPoints(Curve=nickname)  # -> Points, Weights, Knots
panel = Panel(polyoffset.Holes)
crv_8 = Curve(item.Item)
cp_3 = ControlPoints(Curve=crv_8)  # -> Points, Weights, Knots
crv_9 = Curve(item.Item1)
panel_2 = Panel(polyoffset.Contour)
points_2 = PointList(Points=cp_3.Points, Size=Slider(61, range=0..1000))
cp_4 = ControlPoints(Curve=crv_9)  # -> Points, Weights, Knots
points_3 = PointList(Points=cp_2.Points, Size=Slider(61, range=0..1000))
points_4 = PointList(Points=cp_2.Points, Size=Slider(61, range=0..1000))
panel_3 = Panel(cp_2.Points)
points_5 = PointList(Points=cp_4.Points, Size=Slider(61, range=0..1000))
